# Grasshopper definition masterscript.gh (Grasshopper 1.0.7)
# plug-ins: MetaHopper, Hops

# ---- group: Hard-Coded Input
# Given a version number MAJOR.MINOR.PATCH, increment the:
# 
# MAJOR version when you make incompatible API changes,
# MINOR version when you add functionality in a backwards compatible manner, and
# PATCH version when you make backwards compatible bug fixes.
# 
# Additional labels for pre-release and build metadata are available as extensions
# to the MAJOR.MINOR.PATCH format.
# 
# more info: https://semver.org/spec/v2.0.0.html
txt_message = Panel("Don't mess with me")

geo_input = Curve([<curve referenced from the Rhino model> x18])

# ---- group: User Input (Optional)
type_descriptivename = Slider(0.05, range=0..0.1)

# ---- group: User Input (Must Use)
geo_input_2 = Curve([<curve referenced from the Rhino model> x18])

# ---- group: User Action (Must Use)
# Code Information: Author:
# Contact:
# 
# Date:
# Project:
button = Button()

# ----
# Key
# Faint Wires between Groups
txt_message_2 = Data(txt_message)
geo_input_3 = Curve(geo_input)

# ----
# Description of
# Group Function
geo_input_4 = Curve(geo_input_3)
txt_message_3 = Data(txt_message_2)
# Goal: Note for future development of code.  Express as an action to complete
move = Move(Geometry=geo_input_4, Motion=Vector(0, 0, 10))  # -> Geometry, Transform

# ---- group: Data/Geo to Check
txt_message_4 = Panel(txt_message_3)

# ---- group: To Output
geo_input_moved = Curve(move.Geometry)

# ----
# Code Description: Master Script controlling project
# 
# 1.0.0 - Project framework
# Master Script
panel = Panel("tasks\Massing.gh")
relpath = RelativePath(Path=panel)
hops = Hops(
    _Path=relpath,
    TaskID="d41f4132-5d79-11ed-9b6a-0242ac120002",
    Radius=Slider(60, range=0..100),
    Height=Slider(200, range=0..1000),
    CacheResultsInMemory=True,
    CacheSolveResults=True,
    RemoteDefinitionLocation="C:\Users\jkamm\git\DevHops\DevHopsGhSamples\tasks\Massing.gh",
    RemoteSolveVersion=(0, 1, 0),
    ShowInput_Enabled=False,
    ShowInput_Path=True,
    SynchronousSolve=True)
# DevHops comonent
# Placeholder for DevHops component
relpath_2 = RelativePath(Path="tasks\Panelization.gh")
hops_2 = Hops(
    _Path=relpath_2,
    TaskID="df63e25a-5d79-11ed-9b6a-0242ac120002",
    IntFaceCountUPerSrf=Slider(4, range=0..10),
    BrepMass=hops,
    CacheResultsInMemory=True,
    CacheSolveResults=True,
    RemoteDefinitionLocation="C:\Users\jkamm\git\DevHops\DevHopsGhSamples\tasks\Panelization.gh",
    RemoteSolveVersion=(0, 1, 0),
    ShowInput_Enabled=False,
    ShowInput_Path=True,
    SynchronousSolve=True)
# Link to kanban?
# Export to images
panel_2 = Panel("tasks\Patterning.gh")
relpath_3 = RelativePath(Path="tasks\SubStructures.gh")
relpath_4 = RelativePath(Path=panel_2)
relpath_5 = RelativePath(Path="tasks\PanelRationalize.gh")
# inputs:
# Pipe Curves
# Panels
# Pattern elements: number of perforation? Surface area of paint?
# outputs:
# data stats
# Visualization
# Texture maps
hops_3 = Hops(
    _Path=relpath_3,
    TaskID="f739958c-5d79-11ed-9b6a-0242ac120002",
    SrfPanelsByScope=hops_2,
    NumPipeRadius=Slider(0.4, range=0..1),
    BrepMass=hops,
    CacheResultsInMemory=True,
    CacheSolveResults=True,
    RemoteDefinitionLocation="C:\Users\jkamm\git\DevHops\DevHopsGhSamples\tasks\SubStructures.gh",
    RemoteSolveVersion=(0, 1, 0),
    ShowInput_Enabled=False,
    ShowInput_Path=True,
    SynchronousSolve=True)  # -> CrvMullionPipes, BrepMullionPipes
# Extract Data for Estimation
hops_4 = Hops(
    _Path=relpath_4,
    TaskID="ea4952b8-5d79-11ed-9b6a-0242ac120002",
    SrfPanelsByScope=hops_2,
    CacheResultsInMemory=True,
    CacheSolveResults=True,
    RemoteDefinitionLocation="C:\Users\jkamm\git\DevHops\DevHopsGhSamples\tasks\Patterning.gh",
    RemoteSolveVersion=(0, 1, 0),
    ShowInput_Enabled=False,
    ShowInput_Path=True,
    SynchronousSolve=True)
hops_5 = Hops(
    _Path=relpath_5,
    TaskID="ADD ID",
    SrfPanelsByScope=hops_2,
    CacheResultsInMemory=True,
    CacheSolveResults=True,
    RemoteDefinitionLocation="C:\Users\jkamm\git\DevHops\DevHopsGhSamples\tasks\PanelRationalize.gh",
    RemoteSolveVersion=(0, 1, 0),
    ShowInput_Enabled=False,
    ShowInput_Path=True,
    SynchronousSolve=True)
