# Grasshopper definition SubStructures.gh (Grasshopper 1.0.7)
# plug-ins: Sasquatch, Fologram For Grasshopper Utilities

# ---- group: Hard-Coded Input
txt_message = Panel("Don't mess with me")  # disabled

geo_input = Curve([<curve referenced from the Rhino model> x18])  # disabled

# ---- group: User Input (Optional)
type_descriptivename = Slider(0.05, range=0..0.1)  # disabled

# ---- group: User Input (Must Use)
geo_input_2 = Curve([<curve referenced from the Rhino model> x18])  # disabled

# ---- group: User Action (Must Use)
# Code Information: Author:
# Contact:
# 
# Date: 11/5/22
# Project: devHops
button = Button()  # disabled

# ----
# Key
# Faint Wires between Groups
txt_message_2 = Data(txt_message)  # disabled
geo_input_3 = Curve(geo_input)  # disabled

# ----
# Description of
# Group Function
geo_input_4 = Curve(geo_input_3)  # disabled
txt_message_3 = Data(txt_message_2)  # disabled
# Goal: Note for future development of code.  Express as an action to complete
move = Move(Geometry=geo_input_4, Motion=Vector(0, 0, 10))  # -> Geometry, Transform; disabled

# ---- group: Data/Geo to Check
txt_message_4 = Panel(txt_message_3)  # disabled

# ---- group: To Output
geo_input_moved = Curve(move.Geometry)  # disabled

# ----
# Code Description: Develop Substructure
# Goals:
# - Mullion lines
# - Panel Tabs?
srf_panelsbyscope = Data(Tree({0}: [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], {1}: [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], {2}: [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], {3}: [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], {4}: [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], {5}: [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]))
geo_inputmass = Geometry(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)

# ----
# horizontal panel edges
# Can be used for sizing variable pipes
# Adjust pipe members to taper by location
srf_panelsbyscope_2 = GetGeometry(srf_panelsbyscope, AtLeast=1, AtMost=1, DeleteInput=False, Filter=1074004029, TreeAccess=False)
Z = UnitZ(Factor=1)
srf_panelsbyscope_3 = Data(srf_panelsbyscope_2)
debrep = DeconstructBrep(Brep=srf_panelsbyscope_3)  # -> Faces, Edges, Vertices
edgesdir = EdgesFromDirections(Brep=srf_panelsbyscope_3, Directions=Z, Reflex=True, Angle=Slider(0.825, range=0..10))  # -> Edges, Indices, Map
cull_i = CullIndex(List=debrep.Edges, Indices=edgesdir.Indices, Wrap=True)
pshift = ShiftPaths(Data=edgesdir.Edges, Offset=-1)
join = JoinCurves(Curves=cull_i, Preserve=False)
midpt = CurveMiddle(Curve=pshift)
cullpt = CullDuplicates(Points=midpt, Tolerance=0.1, CullMode=1)  # -> Points, Indices, Valence
crv_horizontal_edges = Data(join)
item = ListItem(List=pshift, Index=cullpt.Indices, Wrap=True)
join_2 = JoinCurves(Curves=item, Preserve=False)
crv_paneledges_vertical = Data(join_2)

# ----
# Develop Substructure
# Make this less garbagey
geo_inputmass_2 = GetGeometry(geo_inputmass, AtLeast=1, AtMost=1, DeleteInput=False, Filter=1074004029, TreeAccess=False)

# ----
# Remove Top And Bottom Surface
geo_inputmass_3 = Geometry(geo_inputmass_2)
debrep_2 = DeconstructBrep(Brep=geo_inputmass_3)  # -> Faces, Edges, Vertices
evalsrf = EvaluateSurface(Surface=reparameterize(debrep_2.Faces), Point=Point(0.5, 0.5, 0))  # -> Point, Normal, UDirection, VDirection, Frame
pdecon = Deconstruct(Point=evalsrf.Point)  # -> XComponent, YComponent, ZComponent
sort = SortList(Keys=pdecon.ZComponent, ValuesA=debrep_2.Faces)  # -> Keys, ValuesA
panel = Panel("""0
-1""")
cull_i_2 = CullIndex(List=sort.ValuesA, Indices=panel, Wrap=True)
join_3 = BrepJoin(Breps=cull_i_2)  # -> Breps, Closed
B = Data(join_3.Breps)

neg = Negative(Value=Slider(1.3, range=0..10))
G = Data(B)
offsetbrep = OffsetBrep(Brep=G, OffsetDistance=neg, Solid=False, SharpEdges=True, Tolerance=0.001)
debrep_3 = DeconstructBrep(Brep=offsetbrep)  # -> Faces, Edges, Vertices
srf_srfstopanel = Data(debrep_3.Faces)
# Code review: Data structure doesn't match assumptions
G_2 = Data(offsetbrep)

# ----
# cull last of each side
C = Data(crv_paneledges_vertical)
L = Data(srf_srfstopanel)
midpt_2 = CurveMiddle(Curve=C)
Z_2 = UnitZ(Factor=1)
line = LineSDL(Start=midpt_2, Direction=Z_2, Length=1)
panel_2 = Panel("Sort Pipes")
crvnear = CurveNearestObject(Curve=line, Geometry=L)  # -> PointA, PointB, Index
item_2 = ListItem(List=L, Index=crvnear.Index, Wrap=True)
pull = PullCurve(Curve=C, Surface=item_2)
C_2 = Data(pull)

G_3 = Data(G_2)
srf_panelsbyscope_4 = Data(G_3)
Z_3 = UnitZ(Factor=1)
debrep_4 = DeconstructBrep(Brep=srf_panelsbyscope_4)  # -> Faces, Edges, Vertices
edgesdir_2 = EdgesFromDirections(Brep=srf_panelsbyscope_4, Directions=Z_3, Reflex=True, Angle=Slider(0.825, range=0..10))  # -> Edges, Indices, Map
item_3 = ListItem(List=debrep_4.Edges, Index=edgesdir_2.Indices, Wrap=True)

merge = Merge(Data1=simplify(C_2), Data2=simplify(item_3))
crv_mullionpipes = Data(merge)
mpipe = MeshPipe(
    Polylines=merge,
    NumberOfSides=Slider(8, range=0..10),
    Tolerance=0.1,
    Radius=Slider(0.4, range=0..1),
    Cap=False,
    Join=False)

panel_3 = Panel(C_2)
context_bake = ContextBake(CrvMullionPipes=crv_mullionpipes)
